# Grasshopper definition ляля.gh (Grasshopper 1.0.7)

series = Series(Start=Slider(0, range=0..10), Step=Slider(6, range=0..10), Count=Slider(6, range=0..10))
panel = Panel("""1
4""")
list_item = ListItem(List=series, Index=panel, Wrap=True)
panel_2 = Panel("""4
9""")
panel_3 = Panel(series)
multiplication = Multiplication(A=list_item, B=panel_2)
panel_4 = Panel(list_item)
panel_5 = Panel(multiplication)
replace_items = ReplaceItems(List=series, Item=multiplication, Indices=panel, Wrap=False)
insert_items = InsertItems(List=series, Item=multiplication, Indices=panel, Wrap=True)
panel_6 = Panel(replace_items)
panel_7 = Panel(insert_items)
param_viewer = ParamViewer(panel_6)
graft_tree = GraftTree(Tree=panel_7, IncludeEmptyLists=True, IncludeNullItems=True)
simplify_tree = SimplifyTree(Tree=graft_tree, Front=False)
flatten_tree = FlattenTree(Tree=graft_tree, Path="{0}")
panel_8 = Panel(graft_tree)
panel_9 = Panel(flatten_tree)
panel_10 = Panel(simplify_tree)
param_viewer_2 = ParamViewer(panel_10)
param_viewer_3 = ParamViewer(panel_8)
param_viewer_4 = ParamViewer(panel_9)

explode_tree = ExplodeTree(Data=panel_10)  # -> Branch0, Branch1, Branch2, Branch3, Branch4, Branch5, Branch6, Branch7
merge = Merge(
    Data1=explode_tree.Branch0,
    Data2=explode_tree.Branch1,
    Data3=explode_tree.Branch2,
    Data4=explode_tree.Branch3,
    Data5=explode_tree.Branch4,
    Data6=explode_tree.Branch5,
    Data7=explode_tree.Branch6,
    Data8=explode_tree.Branch7)
panel_11 = Panel(merge)

panel_12 = Panel(explode_tree.Branch7)
panel_13 = Panel("Блок просто так")
